# Dynamo graph Перевод_TM_Rect to WGS-84_MSK-50-2.dyn (Dynamo 2.5.1.7586)

code_block = CodeBlock()
# ---------- code_block.designscript (386 lines) ----------
"Russia-MGGT";
"Russia-MSK01-Zona1";
"Russia-MSK01-Zona2";
"Russia-MSK02-Zona1";
"Russia-MSK02-Zona2";
"Russia-MSK03-Zona1";
"Russia-MSK03-Zona2";
"Russia-MSK03-Zona3";
"Russia-MSK03-Zona4";
"Russia-MSK03-Zona5";
"Russia-MSK03-Zona6";
"Russia-MSK03-Zona7";
"Russia-MSK04-Zona1";
"Russia-MSK04-Zona2";
"Russia-MSK05-Zona1";
"Russia-MSK06-Zona1";
"Russia-MSK07-Zona1";
"Russia-MSK08-Zona1";
"Russia-MSK08-Zona2";
"Russia-MSK08-Zona3";
"Russia-MSK09-Zona1";
"Russia-MSK10-Zona1";
"Russia-MSK10-Zona2";
"Russia-MSK11-Zona1";
"Russia-MSK11-Zona2";
"Russia-MSK11-Zona3";
"Russia-MSK11-Zona4";
"Russia-MSK11-Zona5";
"Russia-MSK11-Zona6";
"Russia-MSK11-Zona7";
"Russia-MSK11-Zona8";
"Russia-MSK11-Zona9";
"Russia-MSK12-Zona1";
"Russia-MSK12-Zona2";
"Russia-MSK13-Zona1";
"Russia-MSK13-Zona2";
"Russia-MSK14-Zona1";
"Russia-MSK14-Zona2";
"Russia-MSK14-Zona3";
"Russia-MSK14-Zona4";
"Russia-MSK14-Zona5";
"Russia-MSK14-Zona6";
"Russia-MSK14-Zona7";
"Russia-MSK14-Zona8";
"Russia-MSK14-Zona9";
"Russia-MSK15-Zona1";
"Russia-MSK16-Zona1";
"Russia-MSK16-Zona2";
"Russia-MSK16-Zona3";
"Russia-MSK18-Zona1";
"Russia-MSK18-Zona2";
"Russia-MSK1964";
"Russia-MSK20-Zona1";
"Russia-MSK20-Zona2";
"Russia-MSK21-Zona1";
"Russia-MSK21-Zona2";
"Russia-MSK22-Zona1";
"Russia-MSK22-Zona2";
"Russia-MSK22-Zona3";
"Russia-MSK23-Zona1";
"Russia-MSK23-Zona2";
"Russia-MSK24-Zona1";
"Russia-MSK24-Zona2";
"Russia-MSK24-Zona3";
"Russia-MSK24-Zona4";
"Russia-MSK24-Zona5";
"Russia-MSK24-Zona6";
"Russia-MSK25-Zona1";
"Russia-MSK25-Zona2";
"Russia-MSK25-Zona3";
"Russia-MSK25-Zona4";
"Russia-MSK26-Zona1";
"Russia-MSK26-Zona2";
"Russia-MSK27-Zona1";
"Russia-MSK27-Zona2";
"Russia-MSK27-Zona3";
"Russia-MSK27-Zona4";
"Russia-MSK27-Zona5";
"Russia-MSK27-Zona6";
"Russia-MSK28-Zona1";
"Russia-MSK28-Zona2";
"Russia-MSK28-Zona3";
"Russia-MSK28-Zona4";
"Russia-MSK28-Zona5";
"Russia-MSK29-Zona1";
"Russia-MSK29-Zona2";
"Russia-MSK29-Zona3";
"Russia-MSK29-Zona4";
"Russia-MSK30-Zona1";
"Russia-MSK30-Zona2";
"Russia-MSK31-Zona1";
"Russia-MSK31-Zona2";
"Russia-MSK32-Zona1";
"Russia-MSK32-Zona2";
"Russia-MSK33-Zona1";
"Russia-MSK33-Zona2";
"Russia-MSK33-Zona3";
"Russia-MSK34-Zona1";
"Russia-MSK34-Zona2";
"Russia-MSK35-Zona1";
"Russia-MSK35-Zona2";
"Russia-MSK35-Zona3";
"Russia-MSK35-Zona4";
"Russia-MSK35-Zona5";
"Russia-MSK36-Zona1";
"Russia-MSK36-Zona2";
"Russia-MSK37-Zona1";
"Russia-MSK37-Zona2";
"Russia-MSK38-Zona1";
"Russia-MSK38-Zona2";
"Russia-MSK38-Zona3";
"Russia-MSK38-Zona4";
"Russia-MSK38-Zona5";
"Russia-MSK38-Zona6";
"Russia-MSK38-Zona7";
"Russia-MSK38-Zona8";
"Russia-MSK39-Zona1";
"Russia-MSK40-Zona1";
"Russia-MSK41-Zona1";
"Russia-MSK41-Zona2";
"Russia-MSK41-Zona3";
"Russia-MSK42-Zona1";
"Russia-MSK42-Zona2";
"Russia-MSK43-Zona1";
"Russia-MSK43-Zona2";
"Russia-MSK43-Zona3";
"Russia-MSK44-Zona1";
"Russia-MSK44-Zona2";
"Russia-MSK44-Zona3";
"Russia-MSK45-Zona1";
"Russia-MSK45-Zona2";
"Russia-MSK45-Zona3";
"Russia-MSK46-Zona1";
"Russia-MSK46-Zona2";
"Russia-MSK47-Zona1";
"Russia-MSK47-Zona2";
"Russia-MSK47-Zona3";
"Russia-MSK48-Zona1";
"Russia-MSK48-Zona2";
"Russia-MSK49-Zona1";
"Russia-MSK49-Zona2";
"Russia-MSK49-Zona3";
"Russia-MSK49-Zona4";
"Russia-MSK50-Zona1";
"Russia-MSK50-Zona2";
"Russia-MSK51-Zona1";
"Russia-MSK51-Zona2";
"Russia-MSK52-NN_Town";
"Russia-MSK52-Zona1";
"Russia-MSK52-Zona2";
"Russia-MSK52-Zona3";
"Russia-MSK53-Zona1";
"Russia-MSK53-Zona2";
"Russia-MSK53-Zona3";
"Russia-MSK54-Zona1";
"Russia-MSK54-Zona2";
"Russia-MSK54-Zona3";
"Russia-MSK54-Zona4";
"Russia-MSK55-Zona1";
"Russia-MSK55-Zona2";
"Russia-MSK56-Zona1";
"Russia-MSK56-Zona2";
"Russia-MSK56-Zona3";
"Russia-MSK56-Zona4";
"Russia-MSK57-Zona1";
"Russia-MSK57-Zona2";
"Russia-MSK57-Zona3";
"Russia-MSK58-Zona1";
"Russia-MSK58-Zona2";
"Russia-MSK59-Zona1";
"Russia-MSK59-Zona2";
"Russia-MSK59-Zona3";
"Russia-MSK60-Zona1";
"Russia-MSK60-Zona2";
"Russia-MSK60-Zona3";
"Russia-MSK61-Zona1";
"Russia-MSK61-Zona2";
"Russia-MSK61-Zona3";
"Russia-MSK62-Zona1";
"Russia-MSK62-Zona2";
"Russia-MSK62-Zona3";
"Russia-MSK63-Zona1";
"Russia-MSK63-Zona2";
"Russia-MSK64-Zona1";
"Russia-MSK64-Zona2";
"Russia-MSK64-Zona3";
"Russia-MSK65-Zona1";
"Russia-MSK66-Zona1";
"Russia-MSK66-Zona1-6d";
"Russia-MSK66-Zona2";
"Russia-MSK66-Zona2-6d";
"Russia-MSK66-Zona3";
"Russia-MSK67-Zona1";
"Russia-MSK67-Zona2";
"Russia-MSK67-Zona3";
"Russia-MSK68-Zona1";
"Russia-MSK68-Zona2";
"Russia-MSK68-Zona3";
"Russia-MSK69-Zona1";
"Russia-MSK69-Zona2";
"Russia-MSK69-Zona3";
"Russia-MSK70-Zona1";
"Russia-MSK70-Zona2";
"Russia-MSK70-Zona3";
"Russia-MSK70-Zona4";
"Russia-MSK70-Zona5";
"Russia-MSK70-Zona6";
"Russia-MSK71-Zona1";
"Russia-MSK71-Zona2";
"Russia-MSK72-Zona1-1.5G";
"Russia-MSK72-Zona1-3G";
"Russia-MSK72-Zona1-6G";
"Russia-MSK72-Zona2-1.5G";
"Russia-MSK72-Zona2-3G";
"Russia-MSK72-Zona2-6G";
"Russia-MSK72-Zona3-1.5G";
"Russia-MSK72-Zona3-3G";
"Russia-MSK72-Zona3-6G";
"Russia-MSK72-Zona4-1.5G";
"Russia-MSK72-Zona4-3G";
"Russia-MSK72-Zona5-1.5G";
"Russia-MSK72-Zona5-3G";
"Russia-MSK72-Zona6-1.5G";
"Russia-MSK73-Zona1";
"Russia-MSK73-Zona2";
"Russia-MSK74-Zona1";
"Russia-MSK74-Zona2";
"Russia-MSK74-Zona3";
"Russia-MSK75-Zona1";
"Russia-MSK75-Zona2";
"Russia-MSK75-Zona3";
"Russia-MSK75-Zona4";
"Russia-MSK75-Zona5";
"Russia-MSK76-Zona1";
"Russia-MSK76-Zona2";
"Russia-MSK83-Zona3";
"Russia-MSK83-Zona4";
"Russia-MSK83-Zona5";
"Russia-MSK83-Zona6";
"Russia-MSK83-Zona7";
"Russia-MSK86-Zona1";
"Russia-MSK86-Zona2";
"Russia-MSK86-Zona3";
"Russia-MSK86-Zona4";
"Russia-MSK86-Zona5";
"Russia-MSK87-Zona3";
"Russia-MSK87-Zona4";
"Russia-MSK87-Zona5";
"Russia-MSK87-Zona6";
"Russia-MSK87-Zona7";
"Russia-MSK87-Zona8";
"Russia-SK63-J6_Zona1";
"Russia-SK63-J6_Zona2";
"Russia-SK63-J6_Zone3";
"Russia-SK63-J6_Zone4";
"Russia-SK63-J6_Zone5";
"Russia-SK63-L3_Zona1";
"Russia-SK63-L3_Zona2";
"Russia-SK63-L3_Zona3";
"Russia-SK63-L3_Zona4";
"Russia-SK63-L3_Zona5";
"Russia-SK63-L6_Zona1";
"Russia-SK63-L6_Zona2";
"Russia-SK63-L6_Zona3";
"Russia-SK63-L6_Zona4";
"Russia-SK63-L6_Zona5";
"Russia-SK63-L6_Zona6";
"Russia-SK63-W3_Zona1";
"Russia-SK63-W3_Zona10";
"Russia-SK63-W3_Zona2";
"Russia-SK63-W3_Zona3";
"Russia-SK63-W3_Zona4";
"Russia-SK63-W3_Zona5";
"Russia-SK63-W3_Zona6";
"Russia-SK63-W3_Zona7";
"Russia-SK63-W3_Zona8";
"Russia-SK63-W3_Zona9";
"Russia-SK63-W6_Zona1";
"Russia-SK63-W6_Zona2";
"Russia-SK63-W6_Zona3";
"Russia-SK63-W6_Zona4";
"Russia-SK63-X3_Zone1";
"Russia-SK63-X3_Zone2";
"Russia-SK63-X3_Zone3";
"Russia-SK63-X3_Zone4";
"Russia-SK63-X3_Zone5";
"Russia-SK63-X3_Zone6";
"Russia-SK63-ZonaC1";
"Russia-SK63-ZonaC2";
"Russia-SK63-ZonaC3";
"Russia-SK63-ZonaC4";
"Russia-SK63-ZonaC5";
"Russia-SK63-ZonaC6";
"Russia-SK63-ZonaD1";
"Russia-SK63-ZonaD2";
"Russia-SK63-ZonaD3";
"Russia-SK63-ZonaD4";
"Russia-SK63-ZonaD5";
"Russia-SK63-ZonaD6";
"Russia-SK63-ZonaD7";
"Russia-SK63-ZonaD8";
"Russia-SK63-ZonaE1";
"Russia-SK63-ZonaE2";
"Russia-SK63-ZonaE3";
"Russia-SK63-ZonaE4";
"Russia-SK63-ZonaE5";
"Russia-SK63-ZonaF1";
"Russia-SK63-ZonaF2";
"Russia-SK63-ZonaF3";
"Russia-SK63-ZonaG1";
"Russia-SK63-ZonaG2";
"Russia-SK63-ZonaG3";
"Russia-SK63-ZonaG4";
"Russia-SK63-ZonaG5";
"Russia-SK63-ZonaG6";
"Russia-SK63-ZonaG7";
"Russia-SK63-ZonaG8";
"Russia-SK63-ZonaG9";
"Russia-SK63-ZonaI1";
"Russia-SK63-ZonaI2";
"Russia-SK63-ZonaI3";
"Russia-SK63-ZonaI4";
"Russia-SK63-ZonaI5";
"Russia-SK63-ZonaI6";
"Russia-SK63-ZonaM1";
"Russia-SK63-ZonaM2";
"Russia-SK63-ZonaM3";
"Russia-SK63-ZonaM4";
"Russia-SK63-ZonaP1";
"Russia-SK63-ZonaP2";
"Russia-SK63-ZonaP3";
"Russia-SK63-ZonaP4";
"Russia-SK63-ZonaQ1";
"Russia-SK63-ZonaQ2";
"Russia-SK63-ZonaQ3";
"Russia-SK63-ZonaQ4";
"Russia-SK63-ZonaQ5";
"Russia-SK63-ZonaR1";
"Russia-SK63-ZonaR2";
"Russia-SK63-ZonaR3";
"Russia-SK63-ZonaS1";
"Russia-SK63-ZonaS10";
"Russia-SK63-ZonaS11";
"Russia-SK63-ZonaS12";
"Russia-SK63-ZonaS13";
"Russia-SK63-ZonaS2";
"Russia-SK63-ZonaS3";
"Russia-SK63-ZonaS4";
"Russia-SK63-ZonaS5";
"Russia-SK63-ZonaS6";
"Russia-SK63-ZonaS7";
"Russia-SK63-ZonaS8";
"Russia-SK63-ZonaS9";
"Russia-SK63-ZonaT1";
"Russia-SK63-ZonaT2";
"Russia-SK63-ZonaT3";
"Russia-SK63-ZonaT4";
"Russia-SK63-ZonaU1";
"Russia-SK63-ZonaU10";
"Russia-SK63-ZonaU11";
"Russia-SK63-ZonaU2";
"Russia-SK63-ZonaU3";
"Russia-SK63-ZonaU4";
"Russia-SK63-ZonaU5";
"Russia-SK63-ZonaU6";
"Russia-SK63-ZonaU7";
"Russia-SK63-ZonaU8";
"Russia-SK63-ZonaU9";
"Russia-SK63-ZonaV1";
"Russia-SK63-ZonaV2";
"Russia-SK63-ZonaV3";
"Russia-SK63-ZonaV4";
"Russia-SK63-ZonaV5";
"Russia-SK63-ZonaV6";
"Russia-Tomsk-town";
"Russia-Town_EKB_1";
"Ukraine-SK63-X_Zona1";
"Ukraine-SK63-X_Zona2";
"Ukraine-SK63-X_Zona3";
"Ukraine-SK63-X_Zona4";
"Ukraine-SK63-X_Zona5";
"Ukraine-SK63-X_Zona6";
"Ukraine-USK-2000_Zone4";
"Ukraine-USK-2000_Zone5";
"Ukraine-USK-2000_Zone6";
"Ukraine-USK-2000_Zone7";
# ----------------------------------------
datumList_ToWGS84 = MapConnection.GeneralTerms.DatumList_ToWGS84()
code_block_2 = CodeBlock { "Krassowsky 1940, EPSG:7024"; "WGS-84, EPSG:7030"; }
ellipsoidParameters = MapConnection.GeneralTerms.EllipsoidParameters(EllipsoidName=code_block_2.out0)
ellipsoidParameters_2 = MapConnection.GeneralTerms.EllipsoidParameters(EllipsoidName=code_block_2.out1)
string = StringInput("Russia-MSK50-Zona2,0,38.48333333333,1,2250000,-5712900.566")
getCSParameters = MapConnection.GeneralTerms.GetCSParameters(CS_Name=string)
number = DoubleInput(222821641)
number_2 = DoubleInput(530448796)
TM_FromRectangleToGeodetic = MapConnection.CoordTransform.TM_FromRectangleToGeodetic(Ellipsoid=ellipsoidParameters, CS_Params=getCSParameters, CoordX=number, CoordY=number_2)
number_3 = DoubleInput(21287)
datum_Recalculation = MapConnection.GeneralTerms.Datum_Recalculation(DatumInfo=datumList_ToWGS84.For_SK_42_to_WGS_84_EPSG_5044, SourceEllipsoid=ellipsoidParameters, FinishEllipsoid=ellipsoidParameters_2, Latitude=TM_FromRectangleToGeodetic.Latitude_radians, Longitude=TM_FromRectangleToGeodetic.Longitude_radians, Height=number_3)
watch = Watch(datum_Recalculation.Latitude_radians)
watch_2 = Watch(datum_Recalculation.Longitude_radians)
