# Dynamo graph ФОрмирование списка СК Пользователя.dyn (Dynamo 2.5.2.7915)
# packages: MapConnection 1.0.3

directory_path = Directory("C:\Users\GeorgKeneberg\Documents\Temp")
boolean = BoolSelector(false)
getCSList = MapConnection.MapCSLibrary.GetCSList(Folder_Path=directory_path, selection=boolean)
